# Grasshopper definition SpiralKarf.gh (Grasshopper 1.0.7)
# plug-ins: Kangaroo2 Components,  GroupObjectCleaner

# ----
# INPUT
spiralcount = Slider(4, range=0..8)
scalefactor = Slider(0.13, range=0..1)
scalefactor_2 = Number(scalefactor)
mesh = Mesh(<mesh referenced from the Rhino model>)
spiralcount_2 = Number(spiralcount)

# ----
# Get mesh vertices and faces
mesh_2 = Mesh(mesh)
demesh = DeconstructMesh(Mesh=mesh_2)  # -> Vertices, Faces, Colours, Normals
face = MeshFace(demesh.Faces)
vert = Point(demesh.Vertices)

# ----
# Get vertices in a checkerboard pattern
# (This point is the starting point of the spiral.)
mesh_3 = Mesh(mesh_2)
vert_2 = Point(vert)
bipartite = Bipartite(Mesh=mesh_3)
dispatch = Dispatch(List=vert_2, DispatchPattern=bipartite)  # -> ListA, ListB
pt = Point(dispatch.ListA)
vert_checkerpattern = Point(pt)

# ----
# Get cells around vertex
mesh_4 = Mesh(mesh_2)
vert_checkerpattern_2 = Point(flatten(vert_checkerpattern))
vert_3 = Point(vert)
face_2 = MeshFace(face)
deface = DeconstructFace(Face=face_2)  # -> graft(CornerA), graft(CornerB), graft(CornerC), graft(CornerD)
merge = Merge(Data1=deface.CornerA, Data2=deface.CornerB, Data3=deface.CornerC, Data4=deface.CornerD)
index = ItemIndex(List=vert_3, Item=vert_checkerpattern_2)
item = ListItem(List=vert_3, Index=merge, Wrap=True)
c_script = CSharpScript(mesh=mesh_4, vindex=index)  # -> AroundCellIndex; inputs mesh: Mesh, vindex: Int32
# ---------- c_script: C# usings ----------
using Rhino.Geometry.Collections;
using System.Linq;
# ---------- c_script: C# ----------
    MeshFaceList faces = mesh.Faces;
    List<int> faceIndexies = new List<int>();
    for(int i = 0; i < faces.Count; i++)
    {
      MeshFace f = faces[i];
      int[] vlist = {f.A, f.B, f.C, f.D};
      if(vlist.Any(k => k == vindex)) faceIndexies.Add(i);
    }
    AroundCellIndex = faceIndexies;
# ---------- end c_script ----------
pline = PolyLine(Vertices=item, Closed=True)  # -> flatten(Polyline)
item_2 = ListItem(List=pline, Index=c_script, Wrap=True)
aroundcell = Curve(item_2)

# ----
# Fix the index of the starting point to 0
aroundcell_2 = Curve(simplify(aroundcell))
vert_checkerpattern_3 = Point(flatten(vert_checkerpattern))
cpoly = ControlPolygon(Curve=aroundcell_2)  # -> Polygon, Points
graft = GraftTree(Tree=vert_checkerpattern_3, IncludeEmptyLists=True, IncludeNullItems=True)
duppt = RemoveDuplicatePts(Points=cpoly.Points, Tolerance=0.01)
pshift = ShiftPaths(Data=duppt, Offset=-2)
lng = ListLength(List=pshift)
division = Division(A=lng, B=4)
repeat = RepeatData(Data=graft, Length=division)  # -> simplify(graft(Data))
dist = Distance(PointA=duppt, PointB=repeat)
similar = Similarity(FirstNumber=dist, SecondNumber="0", Threshold=1)  # -> Similarity, AbsoluteDifference
c_script_2 = CSharpScript(x=similar.Similarity)  # -> A; inputs x: list of Boolean
# ---------- c_script_2: C# ----------
    for(int i = 0; i < x.Count; i++)
    {
      if(x[i]) A = i;
    }
# ---------- end c_script_2 ----------
shift = ShiftList(List=duppt, Shift=c_script_2, Wrap=True)
pline_2 = PolyLine(Vertices=shift, Closed=True)  # -> simplify(Polyline)
aroundcell_fixed = Curve(pline_2)

# ----
# Form a spiral
aroundcell_fixed_2 = Curve(aroundcell_fixed)
spiralcount_3 = Number(spiralcount_2)
scalefactor_3 = Number(scalefactor_2)
pcen = PolygonCenter(Polyline=aroundcell_fixed_2)  # -> CenterV, CenterE, CenterA
subtraction = Subtraction(A=spiralcount_3, B=1)
scale = Scale(Geometry=aroundcell_fixed_2, Center=pcen.CenterA, Factor=scalefactor_3)  # -> Geometry, Transform
division_2 = Division(A="1", B=subtraction)
series = Series(Start=0, Step=division_2, Count=spiralcount_3)
tweencrv = TweenCurve(CurveA=aroundcell_fixed_2, CurveB=scale.Geometry, Factor=series, BlendType=0)
c_script_3 = CSharpScript(x=tweencrv)  # -> A; inputs x: list of Polyline
# ---------- c_script_3: C# ----------
    Polyline polyline = x[0];
    List<Point3d> pts = new List<Point3d>();
    pts.Add(x[0][0]);
    for(int i = 0; i < x.Count-1; i++)
    {
      Polyline pLine0 = x[i];
      Polyline pLine1 = x[i + 1];
      Point3d ptA = pLine0[(0 + 2*i)%4];
      Point3d ptB = pLine0[(1 + 2*i)%4];
      Point3d ptC = pLine1[(1 + 2*i)%4];
      Point3d ptD = pLine1[(2 + 2*i)%4];
      
      Point3d Intersection = CulcIntersection(ptA, ptB, ptC, ptD);
      pts.Add(Intersection);
      pts.Add(ptD);
    }
    
    A = pts;
# ---------- c_script_3: C# additional code ----------
  private Point3d CulcIntersection(Point3d ptA, Point3d ptB, Point3d ptC, Point3d ptD)
  {
    Vector3d AB = new Vector3d(ptB - ptA);
    Vector3d CD = new Vector3d(ptD - ptC);
    Vector3d AC = new Vector3d(ptC - ptA);
    double ABxCD = Vector3d.CrossProduct(AB, CD).Length;
    double ACxCD = Vector3d.CrossProduct(AC, CD).Length;
    double t = ACxCD / ABxCD;
    Point3d newPt = ptA + AB*t;
    return newPt;
  }
# ---------- end c_script_3 ----------
pline_3 = PolyLine(Vertices=c_script_3, Closed=False)
crv = Curve(pline_3)

# ----
# OUTPUT
mesh_5 = Mesh(mesh_2)
crv_2 = Curve(flatten(crv))
medges = MeshEdges(Mesh=mesh_5)  # -> NakedEdges, InteriorEdges, NonManifoldEdges
line = Line(medges.NakedEdges)
join = JoinCurves(Curves=line, Preserve=False)  # -> flatten(Curves)
merge_2 = Merge(Data1=crv_2, Data2=join)
crv_3 = Curve(merge_2)
